# Dynamo graph MergePDF.dyn (Dynamo 2.0.3.8810)

code_block = CodeBlock()
# ---------- code_block.designscript (6 lines) ----------
//input documents
["%userprofile%\\Downloads\\PDF\\pdf1.pdf",
"%userprofile%\\Downloads\\PDF\\pdf2.pdf"];

//output file path
"%userprofile%\\Downloads\\PDF\\result.pdf";
# ----------------------------------------
mergePDF = Orchid.Common.Print.MergePDF(documents=code_block.out0, filePath=code_block.out1)
