# Dynamo graph Print.dyn (Dynamo 2.0.4.12684)

code_block = CodeBlock()
# ---------- code_block.designscript (7 lines) ----------
"Adobe PDF";
"Microsoft Print to PDF";
"Microsoft XPS Document Writer";

//Hidden built-in printer
//not supported at the moment!
"Revit DWF Exporter";
# ----------------------------------------
string = StringInput("Default")  # graph input
code_block_2 = CodeBlock { 100; }
printer = Printer(index=3)  # graph input
string_2 = StringInput("testSetting")  # graph input
createSetting = Orchid.Common.Print.CreateSetting(printer=printer, name=string_2)
print_papersizes = PaperSize(p=printer)  # nothing selected
print_pageorientation = PageOrientation(index=0)  # graph input
print_margintype = MarginType(index=2)  # graph input
code_block_3 = CodeBlock { [10,10]; }
changeSetting = Orchid.Common.Print.ChangeSetting(printer=printer, printSetting=createSetting, paperZize=print_papersizes, pageOrientation=print_pageorientation, marginType=print_margintype, margin=code_block_3)
printer_2 = Printer(index=3)  # graph input
sheet_set = SheetSet(index=0)  # graph input
getView = Orchid.RevitProject.Views.SheetSet.GetView(viewSheetSet=sheet_set)

# group: filePath --> file name incl. path
current = Orchid.Common.Directory.Current()
string_3 = StringInput("testSet")  # graph input
sheetNumber = Sheet.SheetNumber(sheet=getView)
code_block_4 = CodeBlock(a=current, b=string_3, c=sheetNumber)
# ---------- code_block_4.designscript (3 lines) ----------
a + "\\" +
b + "\\" +
c;
# ----------------------------------------

# note: Print Setting may be set
# both as an element and
# as a string
print_setting = Setting(index=0)  # graph input
byViewSheetSet = Orchid.Common.Print.ByViewSheetSet(printer=printer_2, filePath=code_block_4, viewSheetSet=sheet_set, printSetting=print_setting)
boolean = BoolSelector(true)  # graph input
boolean_2 = BoolSelector(true)  # graph input
byView = Orchid.Common.Print.ByView(printer=printer_2, combine=boolean, file=boolean_2, filePath=code_block_4, view=getView, printSetting=print_setting)
# note: Set to "Select" to print the selected views
print_range = Range(index=2)  # graph input

# group: Remove print setting
print_setting_2 = Setting(index=0)  # graph input
# note: Print Setting may be set
# both as an element and
# as a string
string_4 = StringInput("testSetting")  # graph input
deleteSetting = Orchid.Common.Print.DeleteSetting(printSetting=string_4)  # frozen

print_zoomtype = ZoomType(index=1)  # graph input
print_paperplacement = PaperPlacement(index=1)  # graph input

# group: Print current view (center and fit to page)
printer_3 = Printer(index=3)  # graph input
string_5 = StringInput("testSetting")  # graph input
print_papersizes_2 = PaperSize(p=printer_3)  # nothing selected
print_paperplacement_2 = PaperPlacement(index=0)  # graph input
print_zoomtype_2 = ZoomType(index=0)  # graph input
createSetting_2 = Orchid.Common.Print.CreateSetting(printer=printer_3, name=string_5, paperZize=print_papersizes_2, paperPlacement=print_paperplacement_2, zoomType=print_zoomtype_2)
print_range_2 = Range(index=0)  # graph input
activeView = Orchid.RevitProject.Common.Document.ActiveView()
byView_2 = Orchid.Common.Print.ByView(printer=printer_3, printRange=print_range_2, view=activeView, printSetting=createSetting_2)
# note: if print options there are rarely set need to be included, then connect:
# "Print.SetOptions" output Printsetting to "Print.ByView" input printSetting!
await_ = Orchid.Common.DataStream.Await(pass=createSetting_2, waitFor=byView_2)
deleteSetting_2 = Orchid.Common.Print.DeleteSetting(printSetting=await_)

# group: SheetSet
categories = Categories(index=447)  # graph input; frozen
all_elements_of_category = ElementsOfCategory(Category=categories)
string_6 = StringInput("testSet")  # graph input
create = Orchid.RevitProject.Views.SheetSet.Create(view=all_elements_of_category, name=string_6)
getView_2 = Orchid.RevitProject.Views.SheetSet.GetView(viewSheetSet=create)
sheet_set_2 = SheetSet(index=0)  # graph input
change = Orchid.RevitProject.Views.SheetSet.Change(view=getView_2, viewSheetSet=sheet_set_2)
delete = Orchid.RevitProject.Views.SheetSet.Delete(viewSheetSet=create)

# group: Print options there are rarely set
boolean_3 = BoolSelector(true)  # graph input
boolean_4 = BoolSelector(false)  # graph input
print_hiddenlineviews = HiddenLineViewsType(index=0)  # graph input
print_rasterquality = RasterQualityType(index=1)  # graph input
print_colordepth = ColorDepthType(index=1)  # graph input
setOptions = Orchid.Common.Print.SetOptions(printSetting=createSetting_2, viewLinksinBlue=boolean_3, hideReforWorkPlanes=boolean_4, hideUnreferencedViewTags=boolean_3, maskCoincidentLines=boolean_3, hideScopeBoxes=boolean_4, hideCropBoundaries=boolean_4, replaceHalftoneWithThinLines=boolean_3, hiddenLineViews=print_hiddenlineviews, rasterQuality=print_rasterquality, colorDepth=print_colordepth)  # frozen

# group: Merge PDF files
code_block_5 = CodeBlock()
# ---------- code_block_5.designscript (6 lines) ----------
//input documents
["%userprofile%\\Downloads\\PDF\\pdf1.pdf",
"%userprofile%\\Downloads\\PDF\\pdf2.pdf"];

//output file path
"%userprofile%\\Downloads\\PDF\\result.pdf";
# ----------------------------------------
mergePDF = Orchid.Common.Print.MergePDF(documents=code_block_5.out0, filePath=code_block_5.out1)  # frozen

paperSize = Orchid.Common.Print.PaperSize(printer=printer)
watch = Watch(paperSize)
