# Dynamo graph Flipped.dyn (Dynamo 2.0.3.8810)

categories = Categories(index=159)  # graph input
all_elements_of_category = ElementsOfCategory(Category=categories)
watch = Watch(all_elements_of_category)

# group: Element
code_block = CodeBlock(data=all_elements_of_category) { data; }
faceFlipped = Orchid.RevitProject.Elements.FamilyInstance.FaceFlipped(familyInstance=code_block)
code_block_2 = CodeBlock { "Opening Side"; "in"; "out"; }
setParameterByName = Element.SetParameterByName(element=faceFlipped.false, parameterName=code_block_2.out0, value=code_block_2.out2)
clean = Orchid.Common.List.Clean(list=setParameterByName)
# note: It is not an error that it cant find a parameter that dosnt exist in all families!
setParameterByName_2 = Element.SetParameterByName(element=faceFlipped.true, parameterName=code_block_2.out0, value=code_block_2.out1)
clean_2 = Orchid.Common.List.Clean(list=setParameterByName_2)

watch_2 = Watch(clean)
watch_3 = Watch(clean_2)

# group: Boolean
code_block_3 = CodeBlock(data=all_elements_of_category) { data; }
isHandFlipped = Orchid.RevitProject.Elements.FamilyInstance.IsHandFlipped(familyInstance=code_block_3)
groupByKey = List.GroupByKey(list=code_block_3, keys=isHandFlipped)
isFaceFlipped = Orchid.RevitProject.Elements.FamilyInstance.IsFaceFlipped(familyInstance=code_block_3)
groupByKey_2 = List.GroupByKey(list=code_block_3, keys=isFaceFlipped)

watch_4 = Watch(groupByKey.groups)
watch_5 = Watch(groupByKey_2.groups)
categories_2 = Categories(index=604)  # graph input
all_elements_of_category_2 = ElementsOfCategory(Category=categories_2)

# group: Boolean
code_block_4 = CodeBlock(data=all_elements_of_category_2) { data; }
isFlipped = Orchid.RevitProject.Elements.Wall.IsFlipped(wall=code_block_4)
groupByKey_3 = List.GroupByKey(list=code_block_4, keys=isFlipped)

watch_6 = Watch(groupByKey_3.groups)

# group: Element
code_block_5 = CodeBlock(data=all_elements_of_category_2) { data; }
flipped = Orchid.RevitProject.Elements.Wall.Flipped(wall=code_block_5)
code_block_6 = CodeBlock { "Comments"; "Is flipped"; "Not flipped"; }
setParameterByName_3 = Element.SetParameterByName(element=flipped.false, parameterName=code_block_6.out0, value=code_block_6.out2)
setParameterByName_4 = Element.SetParameterByName(element=flipped.true, parameterName=code_block_6.out0, value=code_block_6.out1)

watch_7 = Watch(setParameterByName_3)
watch_8 = Watch(setParameterByName_4)
hashing = Orchid.Common.Object.Hashing(element=all_elements_of_category_2)
watch_9 = Watch(hashing.Element)
watch_10 = Watch(hashing.hashing)
watch_11 = Watch(groupByKey.unique_keys)
watch_12 = Watch(groupByKey_2.unique_keys)
watch_13 = Watch(groupByKey_3.unique_keys)

# group: Element
code_block_7 = CodeBlock(data=all_elements_of_category) { data; }
handFlipped = Orchid.RevitProject.Elements.FamilyInstance.HandFlipped(familyInstance=code_block_7)
code_block_8 = CodeBlock { "Hinge Side"; "R"; "L"; }
setParameterByName_5 = Element.SetParameterByName(element=handFlipped.false, parameterName=code_block_8.out0, value=code_block_8.out2)
setParameterByName_6 = Element.SetParameterByName(element=handFlipped.true, parameterName=code_block_8.out0, value=code_block_8.out1)

watch_14 = Watch(setParameterByName_5)
watch_15 = Watch(setParameterByName_6)
handOrientation = Orchid.RevitProject.Elements.FamilyInstance.HandOrientation(familyInstance=all_elements_of_category)
watch_16 = Watch(handOrientation)
