# Dynamo graph SpatialElement.dyn (Dynamo 2.0.3.8810)

# group: Spatial Elements
getBoundary = Orchid.RevitProject.Elements.SpatialElement.GetBoundary()
watch = Watch(getBoundary.SpatialElement)
watch_2 = Watch(getBoundary.Element)
getSeparationLine = Orchid.RevitProject.Elements.SpatialElement.GetSeparationLine()
watch_3 = Watch(getSeparationLine.SpatialElement)
watch_4 = Watch(getSeparationLine.Element)
watch_5 = Watch(getBoundary.Curve)
watch_6 = Watch(getSeparationLine.Curve)

# group: Rooms, Spaces, Areas
getAreaBoundary = Orchid.RevitProject.Elements.SpatialElement.GetAreaBoundary()
watch_7 = Watch(getAreaBoundary.Area)
watch_8 = Watch(getAreaBoundary.Element)
getSpaceBoundary = Orchid.RevitProject.Elements.SpatialElement.GetSpaceBoundary()
watch_9 = Watch(getSpaceBoundary.Space)
watch_10 = Watch(getSpaceBoundary.Element)
getRoomBoundary = Orchid.RevitProject.Elements.SpatialElement.GetRoomBoundary()
watch_11 = Watch(getRoomBoundary.Room)
watch_12 = Watch(getRoomBoundary.Element)
watch_13 = Watch(getRoomBoundary.Curve)
watch_14 = Watch(getSpaceBoundary.Curve)
watch_15 = Watch(getAreaBoundary.Curve)

categories = Categories(index=74)  # graph input
categories_2 = Categories(index=457)  # graph input
categories_3 = Categories(index=425)  # graph input
all_elements_of_category = ElementsOfCategory(Category=categories_3)
getSeparationLine_2 = Orchid.RevitProject.Elements.SpatialElement.GetSeparationLine(spatialElement=all_elements_of_category)
watch_16 = Watch(getSeparationLine_2.Element)
watch_17 = Watch(getSeparationLine_2.Curve)
getBoundary_2 = Orchid.RevitProject.Elements.SpatialElement.GetBoundary(spatialElement=all_elements_of_category)
watch_18 = Watch(getBoundary_2.Element)
watch_19 = Watch(getBoundary_2.Curve)

# group: Revit links
categories_4 = Categories(index=74)  # graph input
categories_5 = Categories(index=457)  # graph input
getRevitFile = Orchid.RevitProject.Common.Link.GetRevitFile()
instance = Orchid.RevitProject.Common.Link.Instance(link=getRevitFile)
document = Orchid.RevitProject.Common.Link.Document(instance=instance)
categories_6 = Categories(index=425)  # graph input
elementByCategory = Orchid.RevitProject.Elements.Selection.ElementByCategory(document=document, category=categories_6)
getSeparationLine_3 = Orchid.RevitProject.Elements.SpatialElement.GetSeparationLine(document=document, spatialElement=elementByCategory.Element)
watch_20 = Watch(getSeparationLine_3.Curve)
getBoundary_3 = Orchid.RevitProject.Elements.SpatialElement.GetBoundary(document=document, spatialElement=elementByCategory.Element)
watch_21 = Watch(getBoundary_3.Curve)
watch_22 = Watch(getSeparationLine_3.Element)
watch_23 = Watch(getBoundary_3.Element)
