# Dynamo graph AddConvert.dyn (Dynamo 2.3.0.5885)
# packages: Orchid 203.3.0.7798

# group: create family type
current = Orchid.RevitProject.Common.Document.Current()
create = Orchid.RevitFamily.FamilyType.Create(familyDocument=current)
name = Orchid.RevitFamily.FamilyType.Name(familyType=create)

# group: Add shared parameter
await_ = Orchid.Common.DataStream.Await(pass=current, waitFor=create)
code_block = CodeBlock()
# ---------- code_block.designscript (14 lines) ----------
//Parameter name
["Creator Name",
"Creator Organization",
"Creator Build"];
//SP Parameter group
"Sheet & Project";
//Parameter group
"PG_ADSK_MODEL_PROPERTIES";
//Instances
true;
//Reporting
true;
//Condense output
false;
# ----------------------------------------
add = Orchid.RevitFamily.SharedParameter.Add(familyDocument=await_, parameterName=code_block.out0, groupName=code_block.out1, group=code_block.out2, instance=code_block.out3)

# group: Set formula
await_2 = Orchid.Common.DataStream.Await(pass=current, waitFor=add)
code_block_2 = CodeBlock()
# ---------- code_block_2.designscript (8 lines) ----------
//Parameter name
["Creator Name",
"Creator Organization",
"Creator Build"];
//Values
["\"Erik Falck Jørgensen\"",
"\"Danish Educational Content\"",
"\"2021.0406.0\""];
# ----------------------------------------
set = Orchid.RevitFamily.Formula.Set(familyDocument=await_2, parameterName=code_block_2.out0, value=code_block_2.out1)

# group: Get Formula
await_3 = Orchid.Common.DataStream.Await(pass=await_2, waitFor=set)
code_block_3 = CodeBlock()
# ---------- code_block_3.designscript (4 lines) ----------
//Parameter name
["Creator Name",
"Creator Organization",
"Creator Build"];
# ----------------------------------------
get = Orchid.RevitFamily.Formula.Get(familyDocument=await_3, parameterName=code_block_3)

watch = Watch(get)

# group: Convert shared parameter to family parameter
name_2 = Orchid.RevitFamily.Parameter.Name(parameter=add)
code_block_4 = CodeBlock()
# ---------- code_block_4.designscript (2 lines) ----------
//Instances
true;
# ----------------------------------------
convert = Orchid.RevitFamily.SharedParameter.Convert(familyDocument=await_, parameterName=name_2, instance=code_block_4)

name_3 = Orchid.RevitFamily.Parameter.Name(parameter=convert)
watch_2 = Watch(name_3)

# group: Remove formula
await_4 = Orchid.Common.DataStream.Await(pass=await_3, waitFor=get)
code_block_5 = CodeBlock()  # same code as code_block_3
remove = Orchid.RevitFamily.Formula.Remove(familyDocument=await_4, parameterName=code_block_5)

# group: Remove parameter value
await_5 = Orchid.Common.DataStream.Await(pass=await_4, waitFor=remove)
code_block_6 = CodeBlock()
# ---------- code_block_6.designscript (8 lines) ----------
//Parameter name
["Creator Name",
"Creator Organization",
"Creator Build"];
//value
["","",""];
//Condense output
false;
# ----------------------------------------
setValue = Orchid.RevitFamily.Parameter.SetValue(familyDocument=await_5, parameterName=code_block_6.out0, value=code_block_6.out1)

# group: Create shared parameter
await_6 = Orchid.Common.DataStream.Await(pass=current, waitFor=create)
code_block_7 = CodeBlock()
# ---------- code_block_7.designscript (8 lines) ----------
//Parameter name
"Dynamo test parameter";
//SP Parameter group
"Dynamo test group";
//SP Parameter type
"Text";
//Parameter group
"PG_ADSK_MODEL_PROPERTIES";
# ----------------------------------------
create_2 = Orchid.RevitFamily.SharedParameter.Create(familyDocument=await_6, parameterName=code_block_7.out0, groupName=code_block_7.out1, type=code_block_7.out2, group=code_block_7.out3)  # frozen

# group: Convert family parameter to shared parameter
code_block_8 = CodeBlock()  # same code as code_block_3
getExternal = Orchid.RevitFamily.Definition.GetExternal(name=code_block_8)
await_7 = Orchid.Common.DataStream.Await(pass=getExternal, waitFor=convert)
convert_2 = Orchid.RevitFamily.Parameter.Convert(familyDocument=await_, definition=await_7)

name_4 = Orchid.RevitFamily.Parameter.Name(parameter=convert_2)
watch_3 = Watch(name_4)

# group: Add shared parameter
await_8 = Orchid.Common.DataStream.Await(pass=current, waitFor=create)
code_block_9 = CodeBlock()
# ---------- code_block_9.designscript (6 lines) ----------
//Parameter name
["test1","test2"];
//SP Parameter type
"Text";
//Parameter group
"PG_ADSK_MODEL_PROPERTIES";
# ----------------------------------------
create_3 = Orchid.RevitFamily.Parameter.Create(familyDocument=await_8, parameterName=code_block_9.out0, type=code_block_9.out1, group=code_block_9.out2)  # frozen
