# Dynamo graph BuiltInParameter.dyn (Dynamo 2.0.4.12684)

all = Orchid.RevitProject.Parameters.BuiltInParameter.All()
name = Orchid.RevitProject.Parameters.BuiltInParameter.Name(parameterId=all)
watch = Watch(name)
watch_2 = Watch(all)
builtin_parameter = BuiltInParameter(index=1148)  # graph input
watch_3 = Watch(builtin_parameter)
name_2 = Orchid.RevitProject.Parameters.BuiltInParameter.Name(parameterId=builtin_parameter)
watch_4 = Watch(name_2)
label = Orchid.RevitProject.Parameters.BuiltInParameter.Label(parameterId=all)
watch_5 = Watch(label)
label_2 = Orchid.RevitProject.Parameters.BuiltInParameter.Label(parameterId=builtin_parameter)
watch_6 = Watch(label_2)
