# Dynamo graph LinkedDocument.dyn (Dynamo 2.0.4.12684)

string = StringInput("%userprofile%\Programming\Source\Testing\Data\2019_Data\")  # graph input
string_2 = StringInput("2019_defaultProject")  # graph input
code_block = CodeBlock(a=string, b=string_2) { a+b+".rvt"; }
fromPath = Orchid.Common.File.FromPath(path=code_block)

# group: Revit links
getRevitFile = Orchid.RevitProject.Common.Link.GetRevitFile()
reload = Orchid.RevitProject.Common.Link.Reload(link=getRevitFile)  # frozen
repath = Orchid.RevitProject.Common.Link.Repath(link=getRevitFile, file=fromPath)  # frozen
unload = Orchid.RevitProject.Common.Link.Unload(link=getRevitFile)  # frozen
watch = Watch(getRevitFile)
name = Element.Name(element=getRevitFile)
watch_2 = Watch(name)

# group: CAD links
getCadFile = Orchid.RevitProject.Common.Link.GetCadFile()
watch_3 = Watch(getCadFile)
name_2 = Element.Name(element=getCadFile)
watch_4 = Watch(name_2)
reload_2 = Orchid.RevitProject.Common.Link.Reload(link=getCadFile)
watch_5 = Watch(reload_2)

# group: Get all linked files
getFile = Orchid.RevitProject.Common.Link.GetFile()
watch_6 = Watch(getFile.Type)
watch_7 = Watch(getFile.Link)

# group: Dropdown selector
linked_files = LinkedFile(index=1)  # graph input
watch_8 = Watch(linked_files)
linked_revit_files = LinkedRevit()  # nothing selected; graph input
watch_9 = Watch(linked_revit_files)
linked_cad_files = LinkedCad()  # nothing selected; graph input
watch_10 = Watch(linked_cad_files)

# group: Convert to Revit link
select_model_element = DSModelElementSelection()  # nothing selected; graph input; frozen
watch_11 = Watch(select_model_element)
convertToLink = Orchid.RevitProject.Common.Link.ConvertToLink(instance=select_model_element)
watch_12 = Watch(convertToLink)

# group: Convert to CAD link
select_model_element_2 = DSModelElementSelection()  # nothing selected; graph input; frozen
watch_13 = Watch(select_model_element_2)
convertToLink_2 = Orchid.RevitProject.Common.Link.ConvertToLink(instance=select_model_element_2)
watch_14 = Watch(convertToLink_2)

# group: Link revit file
string_3 = StringInput(".\defaultBuilding_2019.rvt")  # graph input
link_positioning = Positioning(index=1)  # graph input
code_block_2 = CodeBlock { 10000; }
byCoordinates = Point.ByCoordinates(y=code_block_2)
attachment_type = AttachmentType(index=0)  # graph input
boolean = BoolSelector(true)  # graph input
setRevitFile = Orchid.RevitProject.Common.Link.SetRevitFile(file=string_3, positioning=link_positioning, referencePoint=byCoordinates, attachmentType=attachment_type, relative=boolean)
watch_15 = Watch(setRevitFile.Instance)
watch_16 = Watch(setRevitFile.Link)

# group: Link cad file
string_4 = StringInput("..\Drawing1.dwg")  # graph input
link_positioning_2 = Positioning(index=0)  # graph input
import_unit = Unit(index=6)  # graph input
import_color_mode = ColorMode(index=2)  # graph input
code_block_3 = CodeBlock { -1000; }
byCoordinates_2 = Point.ByCoordinates(y=code_block_3)
model_views = ModelView(index=0)  # graph input
boolean_2 = BoolSelector(false)  # graph input
setCadFile = Orchid.RevitProject.Common.Link.SetCadFile(file=string_4, positioning=link_positioning_2, unit=import_unit, colorMode=import_color_mode, referencePoint=byCoordinates_2, view=model_views, orientToView=boolean_2)
watch_17 = Watch(setCadFile.Instance)
watch_18 = Watch(setCadFile.Link)

# group: Link cad file
string_5 = StringInput("..\Drawing1.dwg")  # graph input
code_block_4 = CodeBlock { -1000; }
byCoordinates_3 = Point.ByCoordinates(x=code_block_4, y=code_block_4)
model_views_2 = ModelView(index=0)  # graph input
boolean_3 = BoolSelector(true)  # graph input

setCadFile_2 = Orchid.RevitProject.Common.Link.SetCadFile(file=string_5, referencePoint=byCoordinates_3, view=model_views_2, orientToView=boolean_3)

# group (continued): Link cad file
watch_19 = Watch(setCadFile_2.Instance)
watch_20 = Watch(setCadFile_2.Link)
