# Dynamo graph SharedParameter.dyn (Dynamo 2.0.4.12684)

# group: Set the shared parameter file
string = StringInput("..\COBie Extension Shared Parameters.txt")  # graph input
code_block = CodeBlock(data=string) { data; }
setFile = Orchid.RevitProject.Parameters.SharedParameter.SetFile(file=code_block)
watch = Watch(setFile)
string_2 = StringInput("%userprofile%\Personal\Modellering\Revit\Common\Shared Parameters.txt")  # graph input
fromPath = Orchid.Common.File.FromPath(path=string_2)

# group: Group by group name and type
groupByGroupNameAndType = Orchid.RevitProject.Parameters.SharedParameter.GroupByGroupNameAndType(file=setFile)
watch_2 = Watch(groupByGroupNameAndType.ParameterName)
watch_3 = Watch(groupByGroupNameAndType.GroupName)
watch_4 = Watch(groupByGroupNameAndType.ParameterType)
watch_5 = Watch(groupByGroupNameAndType.Definition)
watch_6 = Watch(groupByGroupNameAndType.Guid)

# group: Group by type and group name
groupByTypeAndGroupName = Orchid.RevitProject.Parameters.SharedParameter.GroupByTypeAndGroupName(file=setFile)
watch_7 = Watch(groupByTypeAndGroupName.ParameterName)
watch_8 = Watch(groupByTypeAndGroupName.Definition)
watch_9 = Watch(groupByTypeAndGroupName.ParameterType)
watch_10 = Watch(groupByTypeAndGroupName.GroupName)
watch_11 = Watch(groupByTypeAndGroupName.Guid)

# group: Get shared parameters by file
byFile = Orchid.RevitProject.Parameters.SharedParameter.ByFile(file=setFile)
watch_12 = Watch(byFile.GroupName)
watch_13 = Watch(byFile.ParameterName)
watch_14 = Watch(byFile.ParameterType)
watch_15 = Watch(byFile.Definition)
watch_16 = Watch(byFile.Guid)

# group: Get shared parameter file
getFile = Orchid.RevitProject.Parameters.SharedParameter.GetFile()
watch_17 = Watch(getFile)

# group: Add shared parameters by file
code_block_2 = CodeBlock()
# ---------- code_block_2.designscript (4 lines) ----------
//Parameter group
"PG_ADSK_MODEL_PROPERTIES";
//Instance
true;
# ----------------------------------------
addByFile = Orchid.RevitProject.Parameters.SharedParameter.AddByFile(file=setFile, group=code_block_2.out0)
name = Element.Name(element=addByFile.Parameter)
watch_18 = Watch(name)
watch_19 = Watch(addByFile.GroupName)

# group: Add IFC parameters
addIFC = Orchid.RevitProject.Parameters.SharedParameter.AddIFC()
name_2 = Element.Name(element=addIFC)
watch_20 = Watch(name_2)

# group: Add BIM7AA parameters
addBIM7AA = Orchid.RevitProject.Parameters.SharedParameter.AddBIM7AA()
name_3 = Element.Name(element=addBIM7AA)
watch_21 = Watch(name_3)
