# Dynamo graph WallHole.dyn (Dynamo 2.3.0.5885)
# packages: Orchid 230.1.0.7755, Orchid 230.1.0.7760, Orchid 230.1.0.7763

# group: Get hole elements as document (family edit)
code_block = CodeBlock { "Generic Models"; }
byName = Category.ByName(name=code_block)
elementByCategory = Orchid.RevitProject.Elements.Selection.ElementByCategory(category=byName)
name = Element.Name(element=elementByCategory.Element)
code_block_2 = CodeBlock()
# ---------- code_block_2.designscript (2 lines) ----------
// Search string
"Hole";
# ----------------------------------------
contains = String.Contains(str=name, searchFor=code_block_2)
filterByBoolMask = List.FilterByBoolMask(list=elementByCategory.Element, mask=contains)
getFamily = FamilyInstance.GetFamily(familyInstance=filterByBoolMask.in)
edit = Orchid.RevitProject.Elements.Family.Edit(family=getFamily)

# group: filter for valid holes and find host elements
get = Orchid.Common.Geometry.GenericForm.Get(document=edit)
solid = Orchid.Common.Geometry.GenericForm.Solid(form=get)
code_block_3 = CodeBlock { "Walls"; }
byName_2 = Category.ByName(name=code_block_3)
elementByCategory_2 = Orchid.RevitProject.Elements.Selection.ElementByCategory(category=byName_2)
elementIntersect = Orchid.Common.Geometry.Solid.ElementIntersect(solid=solid, elements=elementByCategory_2.Element)

# group: close document
await_ = Orchid.Common.DataStream.Await(pass=edit, waitFor=get)
close = Orchid.RevitProject.Common.Document.Close(document=await_)
